# Grasshopper definition 4_2字符串至地形.gh (Grasshopper 1.0.7)

path = FilePath("G:\architecture\DigitalDesign\面向建筑师的编程设计\GhPython\地形数据.txt")
file = ReadFile(File=path, PerLineParse=True)
panel = Panel(path)
split = TextSplit(Text=file, Separators=",")
num2pt = NumbersToPoints(Numbers=split, Mask=4)  # -> flatten(Points)
del = DelaunayMesh(Points=num2pt, Plane=PlaneXY(0, 0, 0))
preview = CustomPreview(Geometry=del, Material=ColourSwatch(SwatchColor=RGB(255, 255, 255)))
panel_2 = Panel(num2pt)
